vi "AM Coherent.gvi"   [LabVIEW Communications System Design Suite 2.0.1]
inputs:
  "AM Signal": waveform<f64> = {dt=1, Y=[]}
  "Carrier": waveform<f64> = {dt=1, Y=[]}
  "cutoff frequency": f64 = 0.125
  "order": i32 = 2
  "error in": error
outputs:
  "Output time domain": waveform<f64>
  "Output signal PSD": T1
  "error out": error
  "DC value": f64
types:
  T1 = cluster{"f0": f64, "df": f64, "magnitude": f64[]}
uses:
  NI::Analysis::Filtering::Butterworth Lowpass Filter (Waveform).gvi
  NI::Analysis::Measurement::AC DC and RMS (single-shot)(Wfm).gvi
  NI::Analysis::Measurement::Power Spectral Density for 1 Chan.gvi
diagram:
  Waveform Multiply($Carrier, $"AM Signal", error in=$"error in") -> (error out=w1, o=w2)
  call "Butterworth Lowpass Filter (Waveform).gvi"(signal=w2, cutoff frequency=$"cutoff frequency", error in=w1, order=$order) -> (filtered signal=w3, error out=w4)
  # removes DC
  call "AC DC and RMS (single-shot)(Wfm).gvi"(signal=w3, error in=w4) -> (error out=w5, DC value=w6)
  Waveform Subtract(error in=w5, x=w3, y=w6) -> (error out=w7, x-y=w8)
  # If this doesn't work it might be because we have multiplied by
  # scalar 2 as opposed to a vector of values.
  Waveform Multiply(2, w8, error in=w7) -> (error out=w9, o=w10)
  $"Output time domain" <- w10
  $"DC value" <- w6
  call "Power Spectral Density for 1 Chan.gvi"(signal=w10, error in=w9) -> (power spectral density=w11, error out=w12)
  $"Output signal PSD" <- w11
  Merge Errors(w12) -> (error out=w13)
  $"error out" <- w13
