vi "AMEnvelopeDetection.gvi"   [LabVIEW Communications System Design Suite 2.0.1]
inputs:
  "AM Signal": waveform<f64> = {dt=1, Y=[]}
  "error in": error
outputs:
  "Output signal PSD": T1
  "Output time domain": waveform<f64>
  "error out": error
types:
  T1 = cluster{"f0": f64, "df": f64, "magnitude": f64[]}
uses:
  NI::Analysis::Filtering::Butterworth Lowpass Filter (Waveform).gvi
  NI::Analysis::Measurement::AC DC and RMS (single-shot)(Wfm).gvi
  NI::Analysis::Measurement::Power Spectral Density for 1 Chan.gvi
diagram:
  Waveform Multiply(3.1415926, $"AM Signal", error in=$"error in") -> (error out=w1, o=w2)
  Property Node(instance in=w2) -> ("Y"=w3, "t0"=w4, "dt"=w5, "attributes"=w6)
  for {
    w7 = each element of w3
    Is Greater Or Equal(x=0, y=w7) -> w9
    case (w9) {
      frame False, Default {
        Multiply(0, w11) -> w10
      }
      frame True {
        w10 = _
      }
    }
    append w10 to w8
  }
  Build Waveform Node(Y=w8, attributes=w6, dt=w5, t0=w4) -> (output waveform=w12)
  call "Butterworth Lowpass Filter (Waveform).gvi"(signal=w12, error in=w1) -> (filtered signal=w13, error out=w14)
  call "AC DC and RMS (single-shot)(Wfm).gvi"(signal=w13, error in=w14) -> (error out=w15, DC value=w16)
  Waveform Subtract(error in=w15, x=w13, y=w16) -> (error out=w17, x-y=w18)
  $"Output time domain" <- w18
  call "Power Spectral Density for 1 Chan.gvi"(signal=w18, error in=w17) -> (power spectral density=w19, error out=w20)
  $"Output signal PSD" <- w19
  Merge Errors(w20) -> (error out=w21)
  $"error out" <- w21
