vi "FM_Modulator.gvi"   [LabVIEW Communications System Design Suite 2.0.1]
panel controls:
  "message amplitude": f64 = 1
  "message frequency": f64 = 10
  "error in": error
  "samples": i32 = 1000
  "sample rate": f64 = 1000
  "carrier frequency": f64 = 10
  "carrier amplitude": f64 = 1
  "Delta F": f64
panel indicators:
  "FM modulated waveform": waveform<f64>
  "error out": error
  "PSD of Waveform": T1
types:
  T1 = cluster{"f0": f64, "df": f64, "magnitude": f64[]}
uses:
  NI::Analysis::Generation::Sine Waveform.gvi
  NI::Analysis::IntegralDifferentiation::Integral x(t).gvi
  NI::Analysis::Measurement::Power Spectral Density for 1 Chan.gvi
diagram:
  call "Sine Waveform.gvi"(amplitude=$"carrier amplitude", frequency=$"carrier frequency", sample rate=$"sample rate", samples=$samples) -> (sine wave=w1, error out=w2)
  call "Sine Waveform.gvi"(amplitude=$"carrier amplitude", frequency=$"carrier frequency", phase in=90, sample rate=$"sample rate", samples=$samples) -> (sine wave=w3, error out=w4)
  Merge Errors(w4, w2) -> (error out=w5)
  call "Sine Waveform.gvi"(amplitude=$"message amplitude", frequency=$"message frequency", error in=$"error in", sample rate=$"sample rate", samples=$samples) -> (sine wave=w6, error out=w7)
  Property Node(instance in=w6) -> ("t0"=w8, "dt"=w9, instance out=w10)
  call "Integral x(t).gvi"(x(t)=w10, dt=w9, error in=w7) -> (error out=w11, integral x(t)=w12)
  Merge Errors(w11, w5) -> (error out=w13)
  Multiply(w12, $"Delta F") -> w14
  Multiply(w14, PiTimes2) -> w15
  Sine And Cosine(x=w15) -> (cos(x)=w16, sin(x)=w17)
  Build Waveform Node(Y=w17, dt=w9, t0=w8) -> (output waveform=w18)
  Waveform Multiply(w18, w1, error in=w13) -> (error out=w19, o=w20)
  Build Waveform Node(Y=w16, dt=w9, t0=w8) -> (output waveform=w21)
  Waveform Multiply(w21, w3, error in=w19) -> (error out=w22, o=w23)
  Waveform Subtract(error in=w22, x=w23, y=w20) -> (error out=w24, x-y=w25)
  $"FM modulated waveform" <- w25
  call "Power Spectral Density for 1 Chan.gvi"(signal=w25, error in=w24) -> (power spectral density=w26, error out=w27)
  $"PSD of Waveform" <- w26
  $"error out" <- w27
